# Dynamo graph Deep 4x purge execution.dyn (Dynamo 2.16.4.10216)
# packages: Genius Loci 2023.7.13, Rhythm 2023.9.1

# group: Deep-purge for model health & file size.
# Automated Model Optimization
current = Document.Current()
boolean = BoolSelector(true)
purgeUnused = Document.PurgeUnused(document=current, fullPurge=boolean)
purge_unused = Custom[Purge Unused](RunIt=boolean, Deeply=boolean, document=current)  # package Genius Loci
ʳʰʸᵗʰᵐ_helpers_purgebindings = Rhythm.Revit.Helpers.Helpers.PurgeBindings(runIt=boolean)
