# Dynamo graph EP.01-Create the NAVISWORKS View.dyn (Dynamo 2.16.4.10216)

# group: Collect the Views
categories = Categories("OST_Views")
all_elements_of_category = ElementsOfCategory(Category=categories)
code_block = CodeBlock { false; }
clean = List.Clean(list=all_elements_of_category, preserveIndices=code_block)

# group: The Coordination View Name
string = StringInput("NAVISWORKS")

# group: Check if the View already exists or not
name = Element.Name(element=clean)
contains = String.Contains(string=name, searchFor=string)
anyTrue = List.AnyTrue(list=contains)
empty = List.Empty()
if_ = RefactoredIf(test=anyTrue, true=empty, false=string)

# group: Vanilla OOTB way To Create the View and Lock it also.
code_block_2 = CodeBlock { 200; -200; }
byCoordinates = Point.ByCoordinates(x=code_block_2.out0, y=code_block_2.out1, z=code_block_2.out0)
byCoordinates_2 = Point.ByCoordinates()
byEyePointAndTarget = AxonometricView.ByEyePointAndTarget(eyePoint=byCoordinates, target=byCoordinates_2, name=if_)
