# Dynamo graph EP.02-Hide ALL Revit rvt links.dyn (Dynamo 2.16.4.10216)

# group: get the revit links category
string = StringInput("RVT Links")
byName = Category.ByName(name=string)

# group: get the COORDINATION view from all the 3D Views
categories = Categories("OST_Views")
all_elements_of_category = ElementsOfCategory(Category=categories)
code_block = CodeBlock { false; }
clean = List.Clean(list=all_elements_of_category, preserveIndices=code_block)
string_2 = StringInput("View Name")
getParameterValueByName = Element.GetParameterValueByName(element=clean, parameterName=string_2)
string_3 = StringInput("NAVISWORKS")
eq = getParameterValueByName == string_3
filterByBoolMask = List.FilterByBoolMask(list=clean, mask=eq)
flatten = List.Flatten(list=filterByBoolMask.in)

# group: get all the revit links in my view (does not work while worksets are off)
all_elements_of_category_in_view = ElementsOfCategoryInView(Category=byName, View=flatten)

# group: Hide the LINKS
flatten_2 = List.Flatten(list=all_elements_of_category_in_view)
byProperties = Revit.Filter.OverrideGraphicSettings.ByProperties()
code_block_2 = CodeBlock { true; }
overrideInView = Element.OverrideInView(element=flatten_2, overrides=byProperties, hide=code_block_2)
