# Dynamo graph EP.03 Zero-Touch Export Prep .dyn "EP.03 Zero-Touch Export Prep" (Dynamo 2.16.4.10216)

# group: INPUT
view_name = StringInput("NAVISWORKS")
run_it = BoolSelector(true)

# group: FILTER FOR COORDINATION view from all the 3D Views
categories = Categories("OST_Views")
all_elements_of_category = ElementsOfCategory(Category=categories)
boolean = BoolSelector(false)
clean = List.Clean(list=all_elements_of_category, preserveIndices=boolean)
string = StringInput("View Name")
getParameterValueByName = Element.GetParameterValueByName(element=clean, parameterName=string)
eq = getParameterValueByName == view_name
filterByBoolMask = List.FilterByBoolMask(list=clean, mask=eq)
firstItem = List.FirstItem(list=filterByBoolMask.in)

# group: HIDE the annotation category
hide_or_unhide_the_annotation = Python(IN[0]=firstItem, IN[1]=run_it)  # "hide or unhide the annotation category"; CPython3
# ---------- hide_or_unhide_the_annotation.python (26 lines) ----------
import sys
import clr

clr.AddReference("RevitAPI")
import Autodesk 
from Autodesk.Revit.DB import View

clr.AddReference("RevitServices")
import RevitServices
from RevitServices.Persistence import DocumentManager 
from RevitServices.Transactions import TransactionManager 

doc = DocumentManager.Instance.CurrentDBDocument
view_source=UnwrapElement(IN[0])
bool=IN[1]

TransactionManager.Instance.EnsureInTransaction(doc)
if bool:
    view_source.AreAnnotationCategoriesHidden=bool
    message='Annotation Category is hide'
else:
    view_source.AreAnnotationCategoriesHidden=bool
    message='Annotation Category is active'
TransactionManager.Instance.TransactionTaskDone()

OUT = message
# ----------------------------------------
