# Dynamo graph EP.04 The Instant Worksets Override.dyn (Dynamo 2.16.4.10216)
# packages: archi-lab.net 2023.213.1722

# group: COORDINATION VIEW NAME
string = StringInput("NAVISWORKS")

# group: FILTER THE VIEW NAME
categories = Categories("OST_Views")
all_elements_of_category = ElementsOfCategory(Category=categories)
string_from_object = FromObject(object=all_elements_of_category)
code_block = CodeBlock { "="; true; }
lastIndexOf = String.LastIndexOf(string=string_from_object, searchFor=code_block.out0, ignoreCase=code_block.out1)
code_block_2 = CodeBlock { 2; }
add = lastIndexOf + code_block_2
length = String.Length(string=string_from_object)
sub = length - lastIndexOf
code_block_3 = CodeBlock { 4; }
sub_2 = sub - code_block_3
substring = String.Substring(string=string_from_object, startIndex=add, length=sub_2)
eq = string == substring
filterByBoolMask = List.FilterByBoolMask(list=all_elements_of_category, mask=eq)
firstItem = List.FirstItem(list=filterByBoolMask.in)

# group: Collect worksets
getAll = archilab.Revit.Elements.Workset.GetAll()
name = archilab.Revit.Elements.Workset.Name(workset=getAll)

string_2 = StringInput("Z-ZZ-00_00-RVT_Links")
eq_2 = name == string_2

# group: HIDDEN WORKSET NAME
string_3 = StringInput("Z-ZZ-00_00-HIDDEN")
eq_3 = name == string_3
or_ = Or(bool0=eq_3, bool1=eq_2)
filterByBoolMask_2 = List.FilterByBoolMask(list=getAll, mask=or_)

# group: HIDE THE WORKSET
string_4 = StringInput("Hidden")
setWorksetVisibility = archilab.Revit.Views.Views.SetWorksetVisibility(view=firstItem, worksets=filterByBoolMask_2.in, visibility=string_4)

# group: VISIBLE (INACTIVE)
string_5 = StringInput("Visible")
setWorksetVisibility_2 = archilab.Revit.Views.Views.SetWorksetVisibility(view=firstItem, worksets=filterByBoolMask_2.out, visibility=string_5)
