# Dynamo graph EP.05 The Devil in the Detail Levels.dyn (Dynamo 2.16.4.10216)
# packages: archi-lab.net 2023.213.1722

# group: VIEW NAME
string = StringInput("NAVISWORKS")
string_2 = StringInput("NAVISWORKS - PIPES")
string_3 = StringInput("NAVISWORKS - DUCTS")
string_4 = StringInput("NAVISWORKS - PIPES FITTING")
string_5 = StringInput("NAVISWORKS - DUCTS FITTING")
string_6 = StringInput("Level 1 HVAC Duct Plan")
list_create = List.Create(item0=string, item1=string_2, item2=string_3, item3=string_4, item4=string_5, item5=string_6)

# group: Filter COORDINATION view from all the 3D Views
categories = Categories("OST_Views")
all_elements_of_category = ElementsOfCategory(Category=categories)
clean = archilab.Lists.Lists.Clean(list=all_elements_of_category)
string_7 = StringInput("View Name")
getParameterValueByName = Element.GetParameterValueByName(element=clean, parameterName=string_7)
eq = getParameterValueByName@L1 == list_create
anyTrue = List.AnyTrue(list=eq@L2)
filterByBoolMask = List.FilterByBoolMask(list=clean, mask=anyTrue)
firstItem = List.FirstItem(list=filterByBoolMask.in)

# group: Level of Detail
string_8 = StringInput("Fine")
setDetailLevel = archilab.Revit.Views.Views.SetDetailLevel(view=filterByBoolMask.in, detailLevel=string_8)

# group: Dsiplay Style(some times break may need to seprate to seprate script + there is an OOTB one for it also)
display_styles = DisplayStylesUI("ShadingWithEdges")
setDisplayStyle = archilab.Revit.Views.Views.SetDisplayStyle(view=setDetailLevel, displayStyle=display_styles)
