# Dynamo graph EP.06 Ready, Automate Viewsets, Go.dyn (Dynamo 2.16.4.10216)

# group: Drawn By / Parameter name value is AP (Not in use currently)
categories = Categories("OST_Sheets")
all_elements_of_category = ElementsOfCategory(Category=categories)
string = StringInput("Drawn By")
getParameterValueByName = Element.GetParameterValueByName(element=all_elements_of_category, parameterName=string)
this_only_items_that_are_ap = CodeBlock(list=getParameterValueByName) { mask = list =="AB"; }
filterByBoolMask = List.FilterByBoolMask(list=all_elements_of_category, mask=this_only_items_that_are_ap)

# group: add the 3D View to it
string_2 = StringInput("NAVISWORKS")
n1_doescontain_2_docorlink = CodeBlock { false; null; }  # "1-DoesContain? 2-DocORLink"
get_view_by_name = Python(IN[0]=string_2, IN[1]=n1_doescontain_2_docorlink.out0, IN[2]=n1_doescontain_2_docorlink.out1)  # IronPython2
# ---------- get_view_by_name.python (62 lines) ----------
#Inspired by cgartland
import clr
clr.AddReference("RevitServices")
from RevitServices.Persistence import DocumentManager
clr.AddReference("RevitAPI")
from Autodesk.Revit.DB import FilteredElementCollector, View, ViewType
clr.AddReference('RevitNodes')
import Revit
clr.ImportExtensions(Revit.Elements)

# inputdoc from Clockwork
inputdoc = UnwrapElement(IN[2])
if inputdoc == None:
	doc = DocumentManager.Instance.CurrentDBDocument
elif inputdoc.GetType().ToString() == "Autodesk.Revit.DB.RevitLinkInstance":
	doc = inputdoc.GetLinkDocument()
elif inputdoc.GetType().ToString() == "Autodesk.Revit.DB.Document":
	doc = inputdoc
else: 
	doc = None

def tolist(obj1):
	if hasattr(obj1,"__iter__"): return obj1
	else: return [obj1]

names = tolist(IN[0])
cont = tolist(IN[1])
cont = cont[0]
outList = []

#ueWrapper from Dimitar Venkov
ueWrapper = None
wrappers = clr.GetClrType(Revit.Elements.ElementWrapper).GetMethods()
for w in wrappers:
	if w.ToString().startswith("Revit.Elements.UnknownElement"):
		ueWrapper = w
		break

views = {}
views_all = FilteredElementCollector(doc).OfClass(View)
# Create a dictionary associating Names to Views
# e.g. {'3D View 1': View3D}
for view in views_all:
	#if not view.IsTemplate:
	views[view.Name] = view

for name in names:
	for key in views.keys():
		if cont:
			if name in key :
				if views[key].IsTemplate and views[key].ViewType == ViewType.ThreeD :
					outList.append(ueWrapper.Invoke(None,(views[key], True)))
				else: outList.append(views[key])
		else:
			if key == name:
				if views[key].IsTemplate and views[key].ViewType == ViewType.ThreeD :
					outList.append(ueWrapper.Invoke(None,(views[key], True)))
				else: outList.append(views[key])
				break

if len(outList)>1 : OUT = outList
else: OUT = outList[0]
# ----------------------------------------
watch = Watch(get_view_by_name)

# group: create the list
list_create = List.Create(item0=filterByBoolMask.in, item1=watch)
flatten = List.Flatten(list=list_create)

# group: AS-BUILT View Set Creation no override
viewset_name = StringInput("AS-BUILT")
overwrite = BoolSelector(true)
python_script = Python(IN[0]=flatten, IN[1]=viewset_name, IN[2]=overwrite)  # IronPython2
# ---------- python_script.python (56 lines) ----------
#Copyright(c) 2015, Dimitar Venkov
# @5devene, dimitar.ven@gmail.com
#code inspired by Harry Mattison
#https://boostyourbim.wordpress.com

import clr

clr.AddReference("RevitServices")
import RevitServices
from RevitServices.Persistence import DocumentManager
from RevitServices.Transactions import TransactionManager
doc = DocumentManager.Instance.CurrentDBDocument

clr.AddReference("RevitAPI")
from Autodesk.Revit.DB import *

def tolist(obj1):
	if hasattr(obj1,"__iter__") : return obj1
	else : return [obj1]

def first(obj1):
	if hasattr(obj1,'__iter__') : return obj1[0]
	else : return obj1

views = UnwrapElement(tolist(IN[0]))
name1 = str(first(IN[1]) )
overwrite = IN[2]
vs_exists = None

fec = FilteredElementCollector(doc).OfClass(ViewSheetSet).GetElementIterator()
fec.Reset()
for f in fec:
	if f.Name == name1:
		vs_exists = f
		break
if vs_exists != None and overwrite:
	TransactionManager.Instance.EnsureInTransaction(doc)
	doc.Delete(vs_exists.Id)
	TransactionManager.Instance.TransactionTaskDone()
	vs_exists = None
elif vs_exists != None and not overwrite:
	OUT = "There's a ViewSet with the same name.\nSet Overwrite to true to continue."
if vs_exists == None:
	vs1 = ViewSet()
	for v in views: (vs1.Insert(v))
	printMan = doc.PrintManager
	printMan.PrintRange = PrintRange.Select
	viewSS = printMan.ViewSheetSetting
	try:
		TransactionManager.Instance.EnsureInTransaction(doc)
		viewSS.CurrentViewSheetSet.Views = vs1
		viewSS.SaveAs(name1)
		TransactionManager.Instance.TransactionTaskDone()
		OUT = "ViewSet created with %s views inside." %len(views)
	except:
		OUT = "The ViewSet could not be created"
# ----------------------------------------
watch_2 = Watch(python_script)

# group: DESIGN View Set Creation no override
viewset_name_2 = StringInput("DESIGN")
overwrite_2 = BoolSelector(true)
python_script_2 = Python(IN[0]=flatten, IN[1]=viewset_name_2, IN[2]=overwrite_2)  # IronPython2; same code as python_script
watch_3 = Watch(python_script_2)

# group: CONSTRUCTION View Set Creation no override
viewset_name_3 = StringInput("CONSTRUCTION")
overwrite_3 = BoolSelector(true)
python_script_3 = Python(IN[0]=flatten, IN[1]=viewset_name_3, IN[2]=overwrite_3)  # IronPython2; same code as python_script
watch_4 = Watch(python_script_3)
