# Dynamo graph EP.07 Who Left CAD Imports on Submission Sheets!.dyn (Dynamo 2.16.4.10216)
# packages: Crumple 2022.5.27, Genius Loci 2023.7.13

# group: project info
code_block = CodeBlock { " | "; }
code_block_2 = CodeBlock { DateTime.Format(DateTime.Now,"G"); }
documents_properties = Custom[Documents Properties]()  # package Genius Loci; Queries the document properties. Works also with familyDocument
code_block_3 = CodeBlock(x=documents_properties.CentralPath) { String.Split(x,"/"); }
code_block_4 = CodeBlock(x=code_block_3) { List.GetItemAtIndex(x,1); }
remove = CodeBlock(string_=documents_properties.FileName) { String.Remove(string_,0,4); }  # "String.Remove"
join = String.Join(separator=code_block, string0=code_block_2, string1=code_block_4, string2=remove)

# group: drawin by = AB
categories = Categories("OST_Sheets")
all_elements_of_category = ElementsOfCategory(Category=categories)
# note: input
parameter_name_input = CodeBlock { "Drawn By"; }
getParameterValueByName = Element.GetParameterValueByName(element=all_elements_of_category, parameterName=parameter_name_input)
drawn_by_ab = CodeBlock(list=getParameterValueByName) { mask = list =="AB"; }
filterByBoolMask = List.FilterByBoolMask(list=all_elements_of_category, mask=drawn_by_ab)

# group: cands that are placed on views along with the name of there views
views = Sheet.Views(sheet=filterByBoolMask.in)
collect_cadlinks = Custom[© Collect.CADLinks]()  # package Crumple; Return all CAD linked instances as well as their types and owner views.
collect_cadimports = Custom[© Collect.CADImports]()  # package Crumple; Returns all CAD import instances as well as their type and view.
instance_list = List.Join(list0=collect_cadlinks.ownerView, list1=collect_cadimports.ownerView)

# group: cross product and high level stuff to get only sheets with AB that have cad in a view or on sheet itself
contains = List.Contains(list=views, item=instance_list@L1, lacing=CrossProduct)
anyTrue = List.AnyTrue(list=contains@L2)
filterByBoolMask_2 = List.FilterByBoolMask(list=filterByBoolMask.in, mask=anyTrue)
string_from_object = FromObject(object=filterByBoolMask_2.in)

# group: dwgs directly on sheets not in views
string_from_object_2 = FromObject(object=instance_list)
code_block_5 = CodeBlock { "Sheet"; true; }
startsWith = String.StartsWith(string=string_from_object_2, searchFor=code_block_5.out0, ignoreCase=code_block_5.out1)
filterByBoolMask_3 = List.FilterByBoolMask(list=string_from_object_2, mask=startsWith)

# group: sheet names with CADS
code_block_6 = CodeBlock(x=string_from_object, y=filterByBoolMask_3.in) { List.Join([x,y]); }
uniqueItems = List.UniqueItems(list=code_block_6)

# group: the report we will check
file_path = Filename(".\CAN ON SHEETS REPORT.txt")
code_block_7 = CodeBlock { "\r"; }
code_block_8 = CodeBlock(projectinfo=join, separator=code_block, sheetsname=uniqueItems) { projectinfo + separator + sheetsname; }
join_2 = String.Join(separator=code_block_7, string0=code_block_8, string1=code_block_7)
appendText = FileSystem.AppendText(filePath=file_path, text=join_2)

# group: Open the Sheet Reports
flow_waitfor = Custom[© Flow.WaitFor](data=file_path, waitFor=appendText)  # package Crumple; Tells the first input to wait for the second input to arrive, then passes on the first input. Really useful for scripts which have branching paths that rely on their outputs to carry each other forward. Quite a few custom packages have a 'passthrough' or 'waitfor' node. I use these all the time, so find it useful to have them contained in this package also.
windows_directoryopen = Custom[© Windows.DirectoryOpen](directoryPath=flow_waitfor)  # package Crumple; Attempts to open a directory path.

# group: open the views
python_script = Python(IN[0]=filterByBoolMask_2.in)  # CPython3
# ---------- python_script.python (57 lines) ----------
import clr

# Import Revit API
clr.AddReference('RevitAPI')
from Autodesk.Revit.DB import *

# Import Revit UI API
clr.AddReference('RevitAPIUI')
from Autodesk.Revit.UI import *

# Import DocumentManager and TransactionManager
clr.AddReference('RevitServices')
from RevitServices.Persistence import DocumentManager
from RevitServices.Transactions import TransactionManager

# Get the current UI Document
uidoc = DocumentManager.Instance.CurrentUIApplication.ActiveUIDocument

# Handle inputs (ensure it behaves correctly whether fed a single item or a list)
sheets_in = IN[0] if isinstance(IN[0], list) else [IN[0]]

# Unwrap Dynamo elements into native Revit API objects
sheets = [UnwrapElement(s) for s in sheets_in]

# =========================================================================
# CRITICAL STEP: 
# Revit API does not allow changing the active view while a transaction 
# is open. Dynamo often leaves transactions open, so we must force close it.
# =========================================================================
TransactionManager.Instance.ForceCloseTransaction()

opened_sheets = []
failed = []

for sheet in sheets:
    # Ensure the element is valid and is a View (ViewSheet inherits from View)
    if sheet and isinstance(sheet, View):
        try:
            # Setting ActiveView synchronously forces Revit to open a new tab
            uidoc.ActiveView = sheet
            opened_sheets.append(sheet.Name)
        except Exception as e:
            try:
                # Fallback to an asynchronous request if the UI is busy
                uidoc.RequestViewChange(sheet)
                opened_sheets.append(sheet.Name)
            except Exception as ex:
                failed.append(f"{sheet.Name} (Error: {ex})")
    else:
        if sheet:
            failed.append(f"Element is not a View or Sheet. Type: {type(sheet)}")

# Format the Output for the Dynamo Node
if failed:
    OUT = f"Opened {len(opened_sheets)} sheets.\nErrors:\n" + "\n".join(failed)
else:
    OUT = f"Successfully opened {len(opened_sheets)} sheets:\n" + "\n".join(opened_sheets)
# ----------------------------------------
