# Dynamo graph EP.08 ISO 19650 Automated NWC Exporter.dyn (Dynamo 2.16.4.10216)
# packages: Genius Loci 2023.7.13, Crumple 2022.5.27

# group: this is the file path is unified according to the ISO amana template
directory_path = Directory("C:\y\BIM && YOU\BIM-and-YOU\EP.08 ISO 19650 Automated NWC Exporter\[PROJECT NAME+NUMBER]\Project Files\Shared\Coordination\NWC")
file_exists = Watch(directory_path)
string = StringInput("\")
# note: Any PC user name + Desktop connector start path
windows_userpaths = Custom[© Windows.UserPaths]()  # package Crumple; This node returns the active username, as well as common user paths including: - Desktop - My Documents - Temp - Dynamo Revit (for active build) - Dynamo Revit logs (" ")
string_2 = StringInput("DC")
string_3 = StringInput("ACCDocs")
string_4 = StringInput("ACGL")
documents_properties = Custom[Documents Properties]()  # package Genius Loci; Queries the document properties. Works also with familyDocument
code_block = CodeBlock { 0; }
code_block_2 = CodeBlock { 16; }
remove = String.Remove(string=documents_properties.CentralPath, startIndex=code_block, count=code_block_2)
string_5 = StringInput("/")
split = String.Split(string=remove, separator0=string_5)
firstItem = List.FirstItem(list=split)
string_6 = StringInput("Project Files")
string_7 = StringInput("2_SHARED")
string_8 = StringInput("IN")
string_9 = StringInput("0_FEDERATED")
string_10 = StringInput("NWC")
join = String.Join(separator=string, string0=windows_userpaths.folder, string1=string_2, string2=string_3, string3=string_4, string4=firstItem, string5=string_6, string6=string_7, string7=string_8, string8=string_9, string9=string_10)
windows_directoryopen = Custom[© Windows.DirectoryOpen](directoryPath=join)  # frozen; package Crumple; Attempts to open a directory path.
directoryExists = FileSystem.DirectoryExists(path=join)
file_exists_2 = Watch(directoryExists)
watch = Watch(join)
watch_2 = Watch(watch)

# group: get the COBie.Component schedule
categories = Categories("OST_Views")
all_elements_of_category = ElementsOfCategory(Category=categories)
string_from_object = FromObject(object=all_elements_of_category)
code_block_3 = CodeBlock { "="; true; }
lastIndexOf = String.LastIndexOf(string=string_from_object, searchFor=code_block_3.out0, ignoreCase=code_block_3.out1)
code_block_4 = CodeBlock { 2; }
add = lastIndexOf + code_block_4
length = String.Length(string=string_from_object)
sub = length - lastIndexOf
code_block_5 = CodeBlock { 4; }
sub_2 = sub - code_block_5
substring = String.Substring(string=string_from_object, startIndex=add, length=sub_2)
string_11 = StringInput("NAVISWORKS")
contains = String.Contains(string=substring, searchFor=string_11)
filterByBoolMask = List.FilterByBoolMask(list=all_elements_of_category, mask=contains)

# group: must to work fore some reason
start = Revit.Transaction.Transaction.Start(input=filterByBoolMask.in)
end = Revit.Transaction.Transaction.End(input=start)

# group: file name
documents_properties_2 = Custom[Documents Properties]()
filterByBoolMask_2 = List.FilterByBoolMask(list=substring, mask=contains)
code_block_6 = CodeBlock(X=documents_properties_2.FileName, Y=filterByBoolMask_2.in) { X+Y; }

# group: what to export
enumerate_naviswork_coordinates = Custom[Enumerate Naviswork Coordinates and Exportscope]()  # package Genius Loci; Use with the "Export NWC in Document" node.
code_block_7 = CodeBlock(x=enumerate_naviswork_coordinates.ExportScope, y=enumerate_naviswork_coordinates.ChooseCoordinates) { x[1]; y[1]; }

# group: export links False = no export true = export
boolean = BoolSelector(false)

# group: Run True=Yes False=No
boolean_2 = BoolSelector(true)

# group: export node process
export_nwc_in_document = Custom[Export NWC in Document](DirectoryPath=file_exists, view=end@L2, Filename=code_block_6@L2, exportScope=code_block_7.out0, chooseCoordinates=code_block_7.out1, ExportLinks=boolean, RunIt=boolean_2, lacing=Shortest)  # package Genius Loci; !! This node needs Navisworks Exporters for Revit to export NWC. This node exports Views to NWC files in the active or given document. Navisworks options are embedded inside the python script.
watch_3 = Watch(export_nwc_in_document.Result)
watch_4 = Watch(export_nwc_in_document.Document)
